# Grasshopper definition morpho envimet.gh (Grasshopper 1.0.8)
# plug-ins: CORE.Toolbox.Grasshopper, Pufferfish, Human, UMCF

# ---- group: Grid / Maximum grid size for Lite version is 50x50x40
number_slider = Slider(50, range=0..100)
number_slider_2 = Slider(22, range=0..100)
number_slider_3 = Slider(40, range=0..100)

# ---- group: Grid
number_slider_4 = Slider(6.425, range=0..10)
number_slider_5 = Slider(2.2, range=0..10)
pt = Point(Point(-191.1475334, -43.55589525, 0))
morpho_grid_size = MorphoGridSize(
    point=pt,
    dim_x=number_slider_4,
    dim_y=number_slider_4,
    num_x=number_slider,
    num_y=number_slider_2,
    num_z=number_slider_3)  # -> out, grid_size; inputs point: Point3d, num_x: Int32, num_y: Int32, num_z: Int32; plug-in component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
morpho_grid = MorphoGrid(grid_size=morpho_grid_size.grid_size)  # -> out, inx_grid; inputs combined_grid: Boolean; plug-in component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
morpho_decomp_grid = MorphoDecomposeGrid(inx_grid=morpho_grid.inx_grid, dir=Slider(0, range=0..100))  # -> out, points; inputs dir: Int32; plug-in component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

# ---- group: Trees / Points selected based on grid
pt_2 = Point(Point(20.87746277, 14.26910324, 0))
pt_3 = Point(Point(33.72746277, 14.26910324, 0))
pt_4 = Point(Point(27.30246277, 1.419103241, 0))

# ---- group: Trees
abstract_deciduos_trees_medimum_cylindri = Panel("02OLDM")  # "Abstract - Deciduos Trees - Medimum - Cylindric, large trunk, dense, medium (15m)"
morpho_point = MorphoPoint(point=pt_2)  # -> out, inx_point; inputs point: list of Point3d; plug-in component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
morpho_point_2 = MorphoPoint(point=pt_3)  # -> out, inx_point; inputs point: list of Point3d; plug-in component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
morpho_point_3 = MorphoPoint(point=pt_4)  # -> out, inx_point; inputs point: list of Point3d; plug-in component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
morpho_plant3d = MorphoPlant3d(inx_point=flatten(morpho_point.inx_point), code=abstract_deciduos_trees_medimum_cylindri)  # -> out, inx_plant3d; inputs inx_point: list; plug-in component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
morpho_plant3d_2 = MorphoPlant3d(inx_point=flatten(morpho_point_2.inx_point), code=abstract_deciduos_trees_medimum_cylindri)  # -> out, inx_plant3d; inputs inx_point: list; plug-in component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
morpho_plant3d_3 = MorphoPlant3d(inx_point=flatten(morpho_point_3.inx_point), code=abstract_deciduos_trees_medimum_cylindri)  # -> out, inx_plant3d; inputs inx_point: list; plug-in component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

# ---- group: Building
morpho_building_mat = MorphoBuildingMaterial(wall_code="000000")  # -> out, material; plug-in component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
brep = Brep(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)
morpho_facegroup = MorphoFacegroup(geometry=brep)  # -> out, inx_facegroup; inputs geometry: list of Mesh; plug-in component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
morpho_building = MorphoBuilding(inx_facegroup=flatten(morpho_facegroup.inx_facegroup), ID=Slider(1, range=0..1), material=morpho_building_mat.material)  # -> out, inx_building, id_count; inputs inx_facegroup: list, ID: Int32, enable_BPS: Boolean; plug-in component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

# ---- group: V0
brep_2 = Brep(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)

# ---- group: Soil
brep_3 = Brep(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)
morpho_facegroup_2 = MorphoFacegroup(geometry=brep_3)  # -> out, inx_facegroup; inputs geometry: list of Mesh; plug-in component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
morpho_soil = MorphoSoil(inx_facegroup=flatten(morpho_facegroup_2.inx_facegroup), ID=Slider(2, range=0..10))  # -> out, inx_soil, id_count; inputs inx_facegroup: list, ID: Int32; plug-in component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

# ---- group: V0
brep_4 = Brep(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)

# ----
crv = Curve(brep_3)
disc = Discontinuity(Curve=crv, Level=1)  # -> Points, Parameters
item = ListItem(List=disc.Points, Index=0, Wrap=True)  # -> Item, Item1, Item2, Item3
annotation_style = AnnotationStyle(Name="custom", ModelScale=Slider(5.8, range=0..100))  # -> AnnotationStyle, Name, ModelScale, TextSettings, DimensionSettings, ArrowSettings, UnitsSettings, LeaderSettings, ToleranceSettings
neg = Negative(Value=Slider(14.1, range=0..100))
pt_5 = ConstructPoint(XCoordinate=Slider(-45.4, range=-700..101), YCoordinate=Slider(-62.3, range=-700..101), ZCoordinate=0)
aligned_dimension = AlignedDimension(PointA=item.Item1, PointB=item.Item2, Offset=neg, Style=annotation_style.AnnotationStyle)  # -> AlignedDimension, Plane, PointA, PointB, Offset, Style
pt_6 = ConstructPoint(XCoordinate=Slider(-223.9, range=-700..101), YCoordinate=Slider(12.2, range=-700..101), ZCoordinate=0)
text_entity = TextEntity(Plane=pt_5, Text="X = 50", Style=annotation_style.AnnotationStyle)  # -> TextEntity, Plane, Text, Style
aligned_dimension_2 = AlignedDimension(PointA=item.Item, PointB=item.Item1, Offset=neg, Style=annotation_style.AnnotationStyle)  # -> AlignedDimension, Plane, PointA, PointB, Offset, Style
prot = RotatePlane(Plane=pt_6, Angle=degrees(Slider(90, range=0..100)))
pt_7 = ConstructPoint(XCoordinate=Slider(-223.9, range=-700..101), YCoordinate=Slider(12.2, range=-700..101), ZCoordinate=0)
text_entity_2 = TextEntity(Plane=prot, Text="Y = 22", Style=annotation_style.AnnotationStyle)  # -> TextEntity, Plane, Text, Style
circle = CircleCNR(Center=morpho_decomp_grid.points, Normal=Vector(0, 0, 1), Radius=Slider(0.5, range=0..1))
merge = Merge(
    Data1=morpho_building.inx_building,
    Data2=morpho_plant3d.inx_plant3d,
    Data3=morpho_plant3d_2.inx_plant3d,
    Data4=morpho_plant3d_3.inx_plant3d,
    Data5=morpho_soil.inx_soil)

# ---- group: Workspace
panel = Panel("C:\Users\makel\AppData\Roaming\ENVI-met\Workspace\SimpleCaseIncreasedBoundary06")
morpho_workspace = MorphoWorkspace(workspace_folder=panel, project_name="SimpleCaseIncreasedBoundary06", envimetFolder="C:\ENVImet5")  # -> out, inx_workspace; inputs userDB: Boolean; plug-in component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

# ---- group: Location
path = FilePath("C:\Users\makel\Documents\ARQ\GT\Spring 2025\Data\USA_GA_Fulton.County.AP-Brown.Field.722195_TMY3.epw")
importepw = LBImportEPW(epw_file=path)  # -> location, dry_bulb_temperature, dew_point_temperature, relative_humidity, wind_speed, wind_direction, direct_normal_rad, diffuse_horizontal_rad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; plug-in component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
decnstrloc = LBDeconstructLocation(location=importepw.location)  # -> name, latitude, longitude, time_zone, elevation; plug-in component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
atlanta_utm_zone = Panel("16")
morpho_utm = MorphoUTM(utm_zone=atlanta_utm_zone, utm_easting="729951.55", utm_northing="3739092.37")  # -> out, utm; plug-in component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
start_longitude_for_utm_zone_16 = Panel("-90")
morpho_location = MorphoLocation(
    name=decnstrloc.name,
    latitude=decnstrloc.latitude,
    longitude=decnstrloc.longitude,
    time_zone=decnstrloc.time_zone,
    utm=morpho_utm.utm,
    longitude_reference=start_longitude_for_utm_zone_16)  # -> out, inx_location; inputs time_zone: Int32; plug-in component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

# ----
# VERIFY WIND SPEED!!!
material = CreateMaterial(
    Diffuse=ColourSwatch(SwatchColor=RGB(44, 176, 0)),
    Specular=RGB(255, 255, 255),
    Emission=RGB(0, 0, 0),
    Transparency=Slider(0.35, range=0..1),
    Shine=0)
brep_5 = Brep([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])
wrap = ShrinkWrap(
    Geometry=brep_5,
    EdgeLength=Slider(1, range=0..10),
    Offset=Slider(0.2, range=0..1),
    Smoothing=0,
    Optimization=Slider(0, range=0..10),
    FillHoles=True)
wires = BrepWireframe(Brep=brep_5, Density=-1)
foliage_shortwave_transmittance = Panel("0.3")
triremesh = TriRemesh(Geometry=wrap, Iterations=25)  # -> Triangulation, Dual, Creases
bbox = BoundingBox(Content=brep_5, Plane=PlaneXY(0, 0, 0), UnionBox=True)  # -> Box, Box_2
merge_2 = Merge(Data1=pt_2, Data2=pt_3, Data3=pt_4)
volume = Volume(Geometry=bbox.Box)  # -> Volume, Centroid
xy = XYPlane(Origin=Point(0, 0, 0))
ln = NaturalLogarithm(Value=foliage_shortwave_transmittance)
lai = Panel("3")
division = Division(A=ln, B=lai)
project = Project(Geometry=volume.Centroid, Plane=xy)  # -> Geometry, Transform
multiplication = Multiplication(A=division, B=-1)
vec2pt = Vector2Pt(PointA=project.Geometry, PointB=merge_2, Unitize=False)  # -> Vector, Length
extinction_coefficient_of_radiation = Panel(multiplication)
wires_2 = BrepWireframe(Brep=brep, Density=-1)

# ---- group: Write INX
morpho_model = MorphoModel(
    inx_workspace=morpho_workspace.inx_workspace,
    inx_grid=morpho_grid.inx_grid,
    inx_location=morpho_location.inx_location,
    inx_objects=flatten(merge),
    is_detailed=Toggle(False),
    run_it=Toggle(True))  # -> out, inx_model; inputs inx_objects: list, is_detailed: Boolean, follow_terrain: Boolean, run_it: Boolean; plug-in component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
morpho_write_model = MorphoWriteModel(inx_model=morpho_model.inx_model, write_it=Toggle(True))  # -> out, file_path; inputs write_it: Boolean; plug-in component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

# ----
mesh = MeshBrep(
    Brep=brep,
    Settings={GridMaxCount=0, GridMinCount=16, JaggedSeams=False, MaxEdgeLength=0, MinEdgeLength=0.0001, MinTolerance=0, Refine=True, RefineAngle=0, RelativeTolerance=0.65, SimplePlanes=True, Tolerance=0})
move = Move(Geometry=triremesh.Triangulation, Motion=vec2pt.Vector)  # -> Geometry, Transform
roundd = RoundToDecimalPlace(NumberX=extinction_coefficient_of_radiation, DecimalPlace=Slider(1, range=0..1), RoundType=0)  # -> Rounded, Difference
triremesh_2 = TriRemesh(Geometry=mesh, Features=wires_2, Iterations=25)  # -> Triangulation, Dual, Creases
foliage_shortwave_albedo_0_10 = Slider(0.1, range=0..0.1)
extinction_coefficient_of_radiation_2 = Panel(roundd.Rounded)
canopy_height = Slider(15, range=0..100)

# ---- group: Dense = 1.0 to 1.5 for prod., 1.3 to 1.5 for des.
number_slider_6 = Slider(1.3, range=0..10)
number_slider_7 = Slider(1, range=0..1)

# ---- group: Extinction coefficient of radiation
kc = Kc(extinction_coefficient_of_radiation_2)

# ----
n = NEvapSides("2")

# ---- group: Buildings Mesh
# Solid Region (Buildings)
mesh_2 = Mesh(triremesh_2.Triangulation)

# ---- group: Vegetation Mesh
# Vegetation Region
mesh_3 = Mesh(move.Geometry)

# ----
preview = CustomPreview(Geometry=mesh_3, Material=material)

material_hamstad5brick = BuildingMaterialHamstad5Brick()
solidmeshparas = SolidMeshParameters()
swatch = ColourSwatch(SwatchColor=RGBA(0, 0, 0, 154))
material_2 = CreateMaterial(Diffuse=swatch, Specular=swatch, Emission=RGB(0, 0, 0), Transparency=Slider(0.7, range=0..1), Shine=0)
preview_2 = CustomPreview(Geometry=mesh_2, Material=swatch)
solidregion = SolidRegion(
    Mesh=mesh_2,
    Material=material_hamstad5brick,
    MeshParameters=solidmeshparas,
    BuildingTemperature=Slider(20, range=0..100))

path_2 = FilePath("C:\Users\makel\AppData\Roaming\ENVI-met\Workspace\SimpleCaseIncreasedBoundary06\Project\SimpleCaseIncreasedBoundarySimulationWithClouds_output\")

X = UnitX(Factor=1)
rotate = Rotate(Geometry=X, Angle=degrees(Slider(180, range=0..359)), Plane=PlaneXY(0, 0, 0))  # -> Geometry, Transform
abl = ABLCondition(WindSpeed=Slider(2, range=0..10), Height=Slider(10, range=0..10), WindDirection=rotate.Geometry)
boxdomaindim = BoxDomainDimensions(
    CellSize=Slider(15, range=0..100),
    FrontAdd=Slider(85.3, range=0..100),
    BackAdd=Slider(180, range=0..300),
    SidesAdd=Slider(40, range=0..100),
    TopAdd=Slider(21.6, range=0..100),
    RefinementBoxAdd=Slider(9.8, range=0..100))
airregion = AirRegion(ABLConditionSetting=abl, BoxDomainParameters=boxdomaindim)

vegproperties = VegetationProperties(
    BetaP=number_slider_7,
    BetaD=number_slider_6,
    H=canopy_height,
    Kc=kc,
    RsMin=Slider(100, range=0..100),
    Rg0=foliage_shortwave_albedo_0_10,
    NEvapSides=n)
vegmeshmeshsettings = VegetationMeshSettings()
swatch_2 = ColourSwatch(SwatchColor=RGB(0, 191, 61))
material_3 = CreateMaterial(Diffuse=swatch_2, Specular=swatch_2, Emission=RGB(0, 0, 0), Transparency=Slider(0.13, range=0..1), Shine=0)
vegregion = VegetationRegion(VegetationMesh=mesh_3, LAD=Slider(1, range=0..1), VegetationProperties=vegproperties, MeshParameters=vegmeshmeshsettings)
preview_3 = CustomPreview(Geometry=mesh_3, Material=material_3)

panel_2 = Panel(path_2)
# Air Region
number_slider_8 = Slider(20.2, range=0..540)

# ---- group: 90 = East
number_slider_9 = Slider(90, range=0..100)

# ----
morpho_output_settings = MorphoOutputSettings(
    write_atmosphere=Toggle(True),
    write_buildings=Toggle(True),
    write_objects=Toggle(True),
    write_green_pass=Toggle(True),
    write_radiation=Toggle(True),
    write_soil=Toggle(True),
    write_surface=Toggle(True),
    write_vegetation=Toggle(True))  # -> out, output_settings; inputs include_nesting_grid: Boolean, netCDF: Boolean, netCDF_in_one_file: Boolean, netCDF_write_only_small_files: Boolean, write_agents: Boolean, write_atmosphere: Boolean, write_buildings: Boolean, write_objects: Boolean, write_green_pass: Boolean, write_nesting: Boolean, write_radiation: Boolean, write_soil: Boolean, write_solar_access: Boolean, write_surface: Boolean, write_vegetation: Boolean; plug-in component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
pt_8 = ConstructPoint(XCoordinate=Slider(135.1, range=0..540), YCoordinate=number_slider_8, ZCoordinate=0)
previewlw = CustomPreviewLineweights(Geometry=wires_2, Shader=ColourSwatch(SwatchColor=RGB(51, 51, 51)), Thickness=Slider(1, range=0..10), Absolute=False)
morpho_main_settings = MorphoMainSettings(
    inx_model=morpho_model.inx_model,
    sim_name="SimpleCaseIncreasedBoundarySimulationWithClouds",
    start_time="00:00:00",
    duration=Slider(20, range=0..100),
    wind_speed=Slider(2, range=0..10),
    wind_direction=number_slider_9,
    initial_temperature=Slider(20, range=0..100))  # -> out, main_settings; inputs duration: Int32, wind_accuracy: Int32; plug-in component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
list = ValueList({"atmosphere", "buildings", "inflow", "inputData", "log", "radiation", "soil", "surface", "vegetation", "windclimate"}, selected="atmosphere")
amp = Amplitude(Vector=rotate.Geometry, Amplitude=Slider(35.3, range=0..100))
number_slider_10 = Slider(4, range=0..10)
concat = Concatenate(FragmentA=panel_2, FragmentB=list)
morpho_output_folder = MorphoOutputFolder(output_folder=panel_2)  # -> out, atmosphere, buildings, radiation, soil, solaraccess, surface, vegetation, pollutants; plug-in component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
vdis = VectorDisplay(Anchor=pt_8, Vector=amp)

# ---- group: Include a .epw weather file and connect to first input of Timing component
# Weather
weather = Weather(EPWFilePath=path)

# ----
duration = Slider(20, range=0..24)
timing = TimingParameters(Weather=weather, StartDay=Slider(174, range=0..364), StartTime=Slider(1, range=0..23), Duration=duration)

panel_3 = Panel(concat)

# ---- group: Based on STAT file for July related to EPW file
low_clouds = Panel("3")
middle_clouds = Panel("3")
high_clouds = Panel("2")

# ----
morpho_clouds = MorphoClouds(low_clouds=low_clouds, middle_clouds=middle_clouds, high_clouds=high_clouds)  # -> out, clouds; plug-in component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

# ---- group: Run SIMX
morpho_simx = MorphoSimx(
    main_settings=morpho_main_settings.main_settings,
    other_settings=flatten([morpho_output_settings.output_settings, morpho_clouds.clouds]),
    run_it=Toggle(True))  # -> out, simx; inputs other_settings: list, run_it: Boolean; plug-in component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
morpho_run_simulation = MorphoRunSimulation(simx=morpho_simx.simx, run_it=Toggle(False))  # -> out; inputs run_it: Boolean; plug-in component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

# ----
# Simulation settings
number_slider_11 = Slider(10, range=0..20)
simsettings = SimulationSettings(NumberOfCPUs=number_slider_11, MaxFluidIteration=Slider(100, range=0..1000))

path_3 = FilePath(panel_3)
c_script = CSharpScript(filePath=path_3, extension="EDT")  # -> out, filePaths; inputs filePath: String, extension: String
# ---------- c_script: C# ----------
// Grasshopper Script Instance
#region Usings
using System;
using System.Linq;
using System.Collections;
using System.Collections.Generic;
using System.Drawing;

using Rhino;
using Rhino.Geometry;

using Grasshopper;
using Grasshopper.Kernel;
using Grasshopper.Kernel.Data;
using Grasshopper.Kernel.Types;
#endregion

public class Script_Instance : GH_ScriptInstance
{
    #region Notes
    /* 
      Members:
        RhinoDoc RhinoDocument
        GH_Document GrasshopperDocument
        IGH_Component Component
        int Iteration

      Methods (Virtual & overridable):
        Print(string text)
        Print(string format, params object[] args)
        Reflect(object obj)
        Reflect(object obj, string method_name)
    */
    #endregion

    private void RunScript(string filePath, string extension, ref object filePaths)
    {
        List<string> matchingFiles = new List<string>();

        string normalizedExtension = extension.TrimStart('.');

        string searchPattern = "*." + normalizedExtension;
        string[] files = System.IO.Directory.GetFiles(filePath, searchPattern);

        matchingFiles.AddRange(files);

        filePaths = matchingFiles;
    }
}
# ---------- end c_script ----------
write = Button()
clear = Button()

# ---- group: Working Directory
path_4 = FilePath("C:\MetaFoam_Cases\")

# ----
lng = ListLength(List=c_script.filePaths)
umcf_case = UrbanMicroClimateFoamCase(
    WriteCase=write,
    ClearCase=clear,
    NewCaseName="UMCF_to_ENVI-met_02",
    WorkingDirectory=path_4,
    AirRegion=airregion,
    VegetationRegion=vegregion,
    BuildingRegion=solidregion,
    TimingSettings=timing,
    SimulationSettings=simsettings)  # -> ModificationLogs, Case, DomainBox, RefinementBox
panel_4 = Panel(lng)
item_2 = ListItem(List=c_script.filePaths, Index=Slider(15, range=0..21), Wrap=True)

# ---- group: Domain box
wires_3 = BrepWireframe(Brep=umcf_case.DomainBox, Density=-1)
preview_4 = CustomPreview(Geometry=wires_3, Material=ColourSwatch(SwatchColor=RGB(0, 0, 0)))

# ----
crv_2 = Curve(wires_3)
dash = DashPattern(Curve=crv_2, Pattern=Slider(6.1, range=0..21))  # -> Dashes, Gaps
item_3 = ListItem(List=crv_2, Index=0, Wrap=True)  # -> Item, Item1, Item2, Item3, Item4, Item5, Item6, Item7, Item8
crv_3 = Curve(item_3.Item8)
end = EndPoints(Curve=crv_3)  # -> Start, End
aligned_dimension_3 = AlignedDimension(PointA=end.Start, PointB=end.End, Offset=expr("X*-1.7", neg), Style=annotation_style.AnnotationStyle)  # -> AlignedDimension, Plane, PointA, PointB, Offset, Style

# ---- group: Refinement box
wires_4 = BrepWireframe(Brep=umcf_case.RefinementBox, Density=-1)
preview_5 = CustomPreview(Geometry=wires_4, Material=ColourSwatch(SwatchColor=RGB(5, 67, 240)))

# ----
# Simulation
# (prepare and run using the same type of process)
prepare_simulation = Button()
run_simulation = Button()

del = DelaunayMesh(Points=morpho_decomp_grid.points, Plane=PlaneXY(0, 0, 0))
quad = Quadrangulate(Mesh=del, Angle=0.03490658504, Ratio=0.875)  # -> Mesh, Count

prepare_simulation_in_parallel = Button()
run_simulation_in_parallel = Button()

Z = UnitZ(Factor=Slider(1.7, range=0..10))
move_2 = Move(Geometry=quad.Mesh, Motion=Z)  # -> Geometry, Transform
split = TextSplit(Text=item_2, Separators="_")

caserun = CaseRun(
    Case=umcf_case.Case,
    PrepareSimulation=prepare_simulation,
    PrepareSimulationInParallel=prepare_simulation_in_parallel,
    RunSimulation=run_simulation,
    RunSimulationInParallel=run_simulation_in_parallel)  # -> Case, LogFileNames, LogFileContent

item_4 = ListItem(List=split, Index=0, Wrap=True)  # -> Item2, Item1, Item
brep_6 = Brep(umcf_case.DomainBox)
panel_5 = Panel(item_4.Item2)
panel_6 = Panel(item_4.Item1)
brep_7 = Brep(brep)
list_2 = ValueList({"Flow u (m/s)": 1, "Flow v (m/s)": 2, "Flow w (m/s)": 3, "Wind Speed (m/s)": 4, "Wind Speed Change ()": 5, "Wind Direction (deg)": 6, "Pressure Perturbation (dPa)": 7, "Potential Air Temperature (°C)": 8, "Air Temperature Delta (K)": 9, "Air Temperature Change (K/h)": 10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}, selected="Wind Speed (m/s)")
morpho_read_grid_slice = MorphoReadGridSlice(
    edt=item_2,
    variable=list_2,
    dir=Slider(2, range=0..2),
    index=Slider(5, range=0..100),
    base_point=pt,
    run_it=Toggle(True))  # -> out, variables, project_name, date, time, selected_variable, face, values; inputs variable: Int32, dir: Int32, index: Int32, base_point: Point3d, run_it: Boolean; plug-in component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
panel_7 = Panel(morpho_read_grid_slice.selected_variable)
morpho_from_face_to_rhinomesh = MorphoFromFaceToRhinoMesh(face=morpho_read_grid_slice.face)  # -> out, rh_mesh; inputs face: list; plug-in component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
mesh_4 = Mesh(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)
box = Box(umcf_case.RefinementBox)
similar = Similarity(FirstNumber=morpho_read_grid_slice.values, SecondNumber="-999", Threshold=0.1)  # -> Similarity, AbsoluteDifference
wires_5 = BrepWireframe(Brep=box, Density=-1)
cull = CullPattern(List=morpho_read_grid_slice.values, CullPattern=invert(similar.Similarity))
faceb = FaceBoundaries(Mesh=morpho_from_face_to_rhinomesh.rh_mesh)
bnd = Bounds(Numbers=cull)
area = Area(Geometry=faceb)  # -> Area, Centroid
cullf = CullFaces(Mesh=morpho_from_face_to_rhinomesh.rh_mesh, Pattern=similar.Similarity)
fields = Panel("""T
U
w""")
panel_8 = Panel(bnd)
brepinc = PointInBrep(Brep=box, Point=area.Centroid, Strict=False)
panel_9 = Panel(cull)
data = Data(["1.763425", "1.687334", "1.637228", "1.577186", "1.525975", "1.491504"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])
# Sorted!
data_2 = Data(["28.38851", "27.774696", "27.820332", "27.870867", "27.927433", "27.991299"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])
data_3 = Data([27.82188225, 27.49581337, 27.68451309, 26.83036041, 27.45022583, 27.54991722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])
data_4 = Data([0.0100108633, 0.01000556374, 0.0100277195, 0.009792407036, 0.009977882385, 0.01000227261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])
data_5 = Data([1.42271173, 0.6377923489, 0.9163609147, 0.3535455465, 0.7859159708, 0.862940371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])
data_6 = Data([0.010171528, 0.009969071, 0.009985846, 0.010003489, 0.010022217, 0.010042208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])
temp_envimet_2pm = Panel(data_3)
humidity_envimet_2pm = Panel(data_4)
wind_speed_envimet_2pm = Panel(data_5)
wind_speed_envimet_2pm_2 = Panel(data)
humidity_envimet_2pm_2 = Panel(data_6)
temp_envimet_2pm_2 = Panel(data_2)
heatmap = LBSpatialHeatmap(values=cull, mesh=cullf)  # -> mesh, legend, title, colors, legend_par, vis_set; plug-in component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
cullf_2 = CullFaces(Mesh=morpho_from_face_to_rhinomesh.rh_mesh, Pattern=invert(brepinc))
cull_2 = CullPattern(List=morpho_read_grid_slice.values, CullPattern=brepinc)
division_2 = Division(A=panel_9, B=Slider(1000, range=0..1000))
faceb_2 = FaceBoundaries(Mesh=cullf)
bnd_2 = Bounds(Numbers=division_2)
area_2 = Area(Geometry=faceb_2)  # -> Area, Centroid
medges = MeshEdges(Mesh=heatmap.mesh)  # -> NakedEdges, InteriorEdges, NonManifoldEdges
similar_2 = Similarity(FirstNumber=cull_2, SecondNumber="-999", Threshold=0.1)  # -> Similarity, AbsoluteDifference
panel_10 = Panel(bnd_2)
data_7 = Data([27.99918, 27.99925, 27.99966, 28.00001, 28.00029, 28.00057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])

# ---- group: Hour
number_slider_12 = Slider(13, range=0..20)

# ----
data_8 = Data(["Grasshopper.Kernel.Types.GH_ObjectWrapper", "Grasshopper.Kernel.Types.GH_ObjectWrapper", "Grasshopper.Kernel.Types.GH_ObjectWrapper", "Grasshopper.Kernel.Types.GH_ObjectWrapper", "Grasshopper.Kernel.Types.GH_ObjectWrapper", "Grasshopper.Kernel.Types.GH_ObjectWrapper"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])
data_9 = Data([0.4075688293, 0.2180901877, 0.2471211042, 0.2237842918, 0.321713174, 0.4903595624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])
data_10 = Data([0.6450027492, 0.51883751, 0.51884361, 0.51884877, 0.51885553, 0.51886517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])
data_11 = Data(["Grasshopper.Kernel.Types.GH_ObjectWrapper", "Grasshopper.Kernel.Types.GH_ObjectWrapper", "Grasshopper.Kernel.Types.GH_ObjectWrapper", "Grasshopper.Kernel.Types.GH_ObjectWrapper", "Grasshopper.Kernel.Types.GH_ObjectWrapper", "Grasshopper.Kernel.Types.GH_ObjectWrapper"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])
data_12 = Data([27.99837, 27.98654, 28.01219, 28.01461, 28.01427, 28.00906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])
roundd_2 = RoundToDecimalPlace(NumberX=panel_9, DecimalPlace="2", RoundType=0)  # -> Rounded, Difference
temp_umcf_2pm = Panel(data_12)
humidity_envimet_2pm_3 = Panel(data_11)
temp_umcf_2pm_2 = Panel(data_7)
humidity_umcf_2pm = Panel(data_8)
wind_umcf_2pm = Panel(data_10)
wind_speed_envimet_2pm_3 = Panel(data_9)
cull_3 = CullPattern(List=cull_2, CullPattern=invert(similar_2.Similarity))
cullf_3 = CullFaces(Mesh=cullf_2, Pattern=similar_2.Similarity)
mesh_5 = Mesh(cullf_3)
filter = StreamFilter(Gate=Slider(0, range=0..1), Stream0=move_2.Geometry, Stream1=mesh_5)
demesh = DeconstructMesh(Mesh=filter)  # -> Vertices, Faces, Colours, Normals
brepinc_2 = PointInBrep(Brep=brep_6, Point=demesh.Vertices, Strict=False)
dispatch = Dispatch(List=demesh.Vertices, DispatchPattern=brepinc_2)  # -> ListA, ListB
pull = PullPoint(Point=dispatch.ListB, Geometry=umcf_case.DomainBox, ClosestOnly=True)  # -> ClosestPoint, Distance, Index
pt_9 = Point(dispatch.ListA)
merge_3 = Merge(Data1=pt_9, Data2=pull.ClosestPoint)
cullpt = CullDuplicates(Points=merge_3, Tolerance=0.1, CullMode=1)  # -> Points, Indices, Valence
del_2 = DelaunayMesh(Points=cullpt.Points, Plane=PlaneXY(0, 0, 0))
quad_2 = Quadrangulate(Mesh=del_2, Angle=0.03490658504, Ratio=0.875)  # -> Mesh, Count
faceb_3 = FaceBoundaries(Mesh=quad_2.Mesh)
demesh_2 = DeconstructMesh(Mesh=quad_2.Mesh)  # -> Vertices, Faces, Colours, Normals
area_3 = Area(Geometry=faceb_3)  # -> Area, Centroid
brepinc_3 = PointInBrep(Brep=brep_7, Point=area_3.Centroid, Strict=False)
brepinc_4 = PointInBrep(Brep=brep_7, Point=demesh_2.Vertices, Strict=False)
cullf_4 = CullFaces(Mesh=quad_2.Mesh, Pattern=brepinc_3)
cullv = CullVertices(Mesh=quad_2.Mesh, Pattern=brepinc_4, Shrink=Toggle(False))
demesh_3 = DeconstructMesh(Mesh=cullv)  # -> Vertices, Faces, Colours, Normals
probing = Probing(
    Run=Button(),
    Case=caserun.Case,
    ProbingName="probing01",
    InterpolationScheme=3,
    Fields=fields,
    ProbingPoints=demesh_3.Vertices)
getprobes = GetProbes(Case=probing, ProbingName="probing01", Field="U")  # -> TimeSteps, simplify(ProbeValues)
getprobes_2 = GetProbes(Case=probing, ProbingName="probing01", Field="T")  # -> TimeSteps, simplify(ProbeValues)
getprobes_3 = GetProbes(Case=probing, ProbingName="probing01", Field="w")  # -> TimeSteps, simplify(ProbeValues)
previewlw_2 = CustomPreviewLineweights(Geometry=[medges.NakedEdges, medges.InteriorEdges], Shader=ColourSwatch(SwatchColor=RGB(13, 13, 13)), Absolute=False)
data_13 = Data(["26.605455", "26.605455", "26.584597", "26.57362", "26.571018", "26.573549"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])
bnd_3 = Bounds(Numbers=cull_3)
tag = TextTag3D(Location=area_2.Centroid, Text=roundd_2.Rounded, Size=1, Colour=ColourSwatch(SwatchColor=RGB(0, 0, 0)), Justification=5)
faceb_4 = FaceBoundaries(Mesh=cullf_3)
data_14 = Data([27.21136284, 27.24101067, 27.2563343, 27.26649475, 27.28602219, 27.3401432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])
data_15 = Data([0.009908890724, 0.009931640625, 0.009951761246, 0.009968753815, 0.009981256485, 0.009986365318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])
data_16 = Data(["1.23095", "1.251905", "1.293345", "1.332136", "1.358199", "1.376583"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])
data_17 = Data([1.707633853, 1.75321126, 1.780124068, 1.77906549, 1.716914535, 1.606866837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])
data_18 = Data([0.009637264, 0.009637264, 0.009634015, 0.009633856, 0.009635882, 0.009639145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])
branch = TreeBranch(Tree=getprobes_3.ProbeValues, Path=number_slider_12, MaintainPaths=True)
branch_2 = TreeBranch(Tree=getprobes_2.ProbeValues, Path=number_slider_12, MaintainPaths=True)
panel_11 = Panel(bnd_3)
temp_envimet_2pm_3 = Panel(data_14)
humidity_envimet_2pm_4 = Panel(data_15)
wind_speed_envimet_2pm_4 = Panel(data_17)
temp_envimet_2pm_4 = Panel(data_13)
wind_speed_envimet_2pm_5 = Panel(data_16)
humidity_envimet_2pm_5 = Panel(data_18)
branch_3 = TreeBranch(Tree=getprobes.ProbeValues, Path=number_slider_12, MaintainPaths=True)
heatmap_2 = LBSpatialHeatmap(values=cull_3, mesh=cullf_3)  # -> mesh, legend, title, colors, legend_par, vis_set; plug-in component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
area_4 = Area(Geometry=faceb_4)  # -> Area, Centroid
panel_12 = Panel(branch_2)
bnd_4 = Bounds(Numbers=branch_2)
vec = Vector(branch_3)
subtraction = Subtraction(A=panel_12, B=273.15)
dedomain = DeconstructDomain(Domain=bnd_4)  # -> Start, End
bnd_5 = Bounds(Numbers=branch)
data_19 = Data([27.9077, 27.9057, 27.90717, 27.90983, 27.91746, 27.93057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])
data_20 = Data(["Grasshopper.Kernel.Types.GH_ObjectWrapper", "Grasshopper.Kernel.Types.GH_ObjectWrapper", "Grasshopper.Kernel.Types.GH_ObjectWrapper", "Grasshopper.Kernel.Types.GH_ObjectWrapper", "Grasshopper.Kernel.Types.GH_ObjectWrapper", "Grasshopper.Kernel.Types.GH_ObjectWrapper"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])
data_21 = Data([0.6499221229, 0.5946318171, 0.58957943, 0.6031161576, 0.6021544525, 0.5874446397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])

# ---- group: Same
data_22 = Data(["1.763425", "1.687334", "1.637228", "1.577186", "1.525975", "1.491504"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])
# Sorted and fixed wind speed!
data_23 = Data(["28.38851", "27.774696", "27.820332", "27.870867", "27.927433", "27.991299"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])
data_24 = Data([27.82188225, 27.49581337, 27.68451309, 26.83036041, 27.45022583, 27.54991722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])
data_25 = Data([0.0100108633, 0.01000556374, 0.0100277195, 0.009792407036, 0.009977882385, 0.01000227261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])
data_26 = Data([1.42271173, 0.6377923489, 0.9163609147, 0.3535455465, 0.7859159708, 0.862940371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])
data_27 = Data([0.010171528, 0.009969071, 0.009985846, 0.010003489, 0.010022217, 0.010042208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])
wind_speed_envimet_2pm_6 = Panel(data_26)
temp_envimet_2pm_5 = Panel(data_24)
humidity_envimet_2pm_6 = Panel(data_25)
wind_speed_envimet_2pm_7 = Panel(data_22)
temp_envimet_2pm_6 = Panel(data_23)
humidity_envimet_2pm_7 = Panel(data_27)

# ----
data_28 = Data([0.3827800923, 0.3675517701, 0.3010593988, 0.04735892666, 0.08873955001, 0.1101595955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])
data_29 = Data([27.44703, 27.50281, 27.57417, 27.65183, 27.69543, 27.75278, 27.81307, 27.87424, 27.90887, 28.10237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])
data_30 = Data(["Grasshopper.Kernel.Types.GH_ObjectWrapper", "Grasshopper.Kernel.Types.GH_ObjectWrapper", "Grasshopper.Kernel.Types.GH_ObjectWrapper", "Grasshopper.Kernel.Types.GH_ObjectWrapper", "Grasshopper.Kernel.Types.GH_ObjectWrapper", "Grasshopper.Kernel.Types.GH_ObjectWrapper"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])
panel_13 = Panel(subtraction)
dedomain_2 = DeconstructDomain(Domain=bnd_5)  # -> Start, End
temp_umcf_2pm_3 = Panel(data_19)
humidity_umcf_2pm_2 = Panel(data_20)
wind_umcf_2pm_2 = Panel(data_21)
temp_umcf_2pm_4 = Panel(data_29)
humidity_envimet_2pm_8 = Panel(data_30)
wind_speed_envimet_2pm_8 = Panel(data_28)
vlen = VectorLength(Vector=vec)
gradient = Gradient(
    LowerLimit=dedomain_2.End,
    UpperLimit=dedomain_2.Start,
    Parameter=branch,
    stops=[0: RGB(234, 38, 0), 0.25: RGB(234, 126, 0), 0.5: RGB(254, 244, 84), 0.75: RGB(173, 203, 249), 1: RGB(75, 107, 169)])
bnd_6 = Bounds(Numbers=panel_13)
bnd_7 = Bounds(Numbers=vlen)
pt_10 = Point(demesh_3.Vertices)
brep_8 = Brep(umcf_case.RefinementBox)
dedomain_3 = DeconstructDomain(Domain=bnd_6)  # -> Start, End
gradient_2 = Gradient(
    LowerLimit=dedomain_3.End,
    UpperLimit=dedomain_3.Start,
    Parameter=panel_13,
    stops=[0.0567: RGB(234, 38, 0), 0.205: RGB(234, 126, 0), 0.629: RGB(254, 244, 84), 0.932: RGB(173, 203, 249), 1: RGB(75, 107, 169)])
dedomain_4 = DeconstructDomain(Domain=bnd_7)  # -> Start, End
panel_14 = Panel(bnd_7)
panel_15 = Panel(bnd_6)
dom = ConstructDomain(DomainStart=Slider(1.1, range=0..3), DomainEnd=Slider(3.6, range=0..10))
remap = RemapNumbers(Value=vlen, Source=bnd_7, Target=dom)  # -> Mapped, Clipped
vec_2 = Vector(branch_3)
demesh_4 = DeconstructMesh(Mesh=cullf)  # -> Vertices, Faces, Colours, Normals
brepinc_5 = PointInBrep(Brep=brep_8, Point=pt_10, Strict=True)
conmesh = ConstructMesh(Vertices=demesh_3.Vertices, Faces=demesh_3.Faces, Colours=gradient_2)
amp_2 = Amplitude(Vector=vec, Amplitude=remap.Mapped)
pt_11 = Point(area_4.Centroid)
pt_12 = Point(area_2.Centroid)
conmesh_2 = ConstructMesh(Vertices=demesh_3.Vertices, Faces=demesh_3.Faces, Colours=gradient)
vlen_2 = VectorLength(Vector=vec_2)
entwine = Entwine(
    Branch00=temp_envimet_2pm_4,
    Branch01=temp_umcf_2pm_3,
    Branch02=humidity_envimet_2pm_5,
    Branch03=humidity_umcf_2pm_2,
    Branch04=wind_speed_envimet_2pm_5,
    Branch05=wind_umcf_2pm_2,
    Branch06=temp_envimet_2pm_3,
    Branch07=temp_umcf_2pm_4,
    Branch08=humidity_envimet_2pm_4,
    Branch09=humidity_envimet_2pm_8,
    Branch010=wind_speed_envimet_2pm_4,
    Branch011=wind_speed_envimet_2pm_8,
    FlattenInputs=True)  # -> simplify(Result)
pt_13 = Point(demesh_4.Vertices)
crv_4 = Curve(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)
dispatch_2 = Dispatch(List=pt_10, DispatchPattern=brepinc_5)  # -> ListA, ListB
dispatch_3 = Dispatch(List=vlen_2, DispatchPattern=brepinc_5)  # -> ListA, ListB
gradient_3 = Gradient(
    LowerLimit=dedomain_4.End,
    UpperLimit=dedomain_4.Start,
    Parameter=vlen,
    stops=[0: RGB(234, 38, 0), 0.25: RGB(234, 126, 0), 0.5: RGB(254, 244, 84), 0.75: RGB(173, 203, 249), 1: RGB(75, 107, 169)])
conmesh_3 = ConstructMesh(Vertices=demesh_3.Vertices, Faces=demesh_3.Faces, Colours=gradient_3)
num = Number(dispatch_3.ListA)
alongcrv = SortAlongCurve(Points=pt_11, Curve=crv_4)  # -> Points, Indices
num_2 = Number(cull_3)
pt_14 = Point(dispatch_2.ListA)
Y = UnitY(Factor=Slider(173, range=0..230))
item_5 = ListItem(List=num_2, Index=alongcrv.Indices, Wrap=True)
vlen_3 = VectorLength(Vector=vec)
vdisex = VectorDisplayEx(Point=demesh_3.Vertices, Vector=amp_2, Colour=gradient_3, Width=2)
move_3 = Move(Geometry=[conmesh, mesh_2, mesh_3], Motion=Y)  # -> Geometry, Transform
move_4 = Move(Geometry=[mesh_2, mesh_3, conmesh_2], Motion=Y)  # -> Geometry, Transform

# ---- group: ENVIMET-DOMAIN-SORTED
num_3 = Number([28.38850975, 28.36311913, 28.3753376, 28.38850975, 28.37613297, 28.37986565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])
num_4 = Number([0.010171528, 0.010156341, 0.01016727, 0.010171528, 0.010166493, 0.01016847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])
num_5 = Number([1.763425, 1.763425, 1.763425, 1.763425, 1.763425, 1.763425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])
temp = Panel(num_3)
humidity = Panel(num_4)
wind_speed = Panel(num_5)

# ---- group: UMCF-DOMAIN-SORTED
num_6 = Number([27.99916, 27.99923, 27.99964, 27.99999, 28.00027, 28.00055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])
num_7 = Number([1.290092917, 1.037675, 1.0376872, 1.0376975, 1.037711, 1.0377303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])
num_8 = Number([0.01088487, 0.01088487, 0.01088487, 0.01088487, 0.01088487, 0.01088487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])
temp_2 = Panel(num_6)
wind_speed_2 = Panel(num_7)
humidity_2 = Panel(num_8)

# ---- group: ENVIMET-REFINEMENT-SORTED
num_9 = Number([1.248434663, 1.370948672, 0.9163609147, 1.055945992, 1.42271173, 1.307795882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])
num_10 = Number([0.01002626419, 0.01001720905, 0.0100277195, 0.01003508663, 0.0100108633, 0.01002356339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])
num_11 = Number([27.79527664, 27.79728127, 27.68451309, 27.70551491, 27.82188225, 27.76607132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])
humidity_3 = Panel(num_9)
humidity_4 = Panel(num_10)
temperature = Panel(num_11)

# ---- group: UMCF-REFINEMENT-SORTED
num_12 = Number([0.5361616496, 0.5207925241, 0.4758042036, 0.4281121581, 0.389167914, 0.4145586135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])
num_13 = Number([27.95016, 27.95076, 27.94903, 27.94733, 27.94619, 27.95707, 27.94927, 27.95817, 27.96307, 27.96237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])
num_14 = Number([0.01088487, 0.010884878, 0.010884897, 0.010884943, 0.010884974, 0.01088487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])
wind_speed_3 = Panel(num_12)
humidity_5 = Panel(num_14)
temp_3 = Panel(num_13)

# ----
panel_16 = Panel("""T_ENVImet_HumanHeight_DomainBox
T_UMCF_HumanHeight_DomainBox
w_ENVImet_HumanHeight_DomainBox
w_UMCF_HumanHeight_DomainBox
U_ENVImet_HumanHeight_DomainBox
U_UMCF_HumanHeight_DomainBox
T_ENVImet_HumanHeight_RefinementBox
T_UMCF_HumanHeight_RefinementBox
w_ENVImet_HumanHeight_RefinementBox
w_UMCF_HumanHeight_RefinementBox
U_ENVImet_HumanHeight_RefinementBox
U_UMCF_HumanHeight_RefinementBox""")
entwine_2 = Entwine(
    Branch00=temp,
    Branch01=temp_2,
    Branch02=humidity,
    Branch03=humidity_2,
    Branch04=wind_speed,
    Branch05=wind_speed_2,
    Branch06=temperature,
    Branch07=temp_3,
    Branch08=humidity_4,
    Branch09=humidity_5,
    Branch010=humidity_3,
    Branch011=wind_speed_3,
    FlattenInputs=True)  # -> simplify(Result)
graft = GraftTree(Tree=panel_16, IncludeEmptyLists=True, IncludeNullItems=True)  # -> simplify(Tree)
merge_4 = Merge(Data1=graft, Data2=entwine_2)
flip = FlipMatrix(Data=merge_4)
nullrep = ReplaceNulls(Items=flip)  # -> Items, Count
path_5 = FilePath("C:\Users\makel\Documents\ARQ\GT\Spring 2025\Data\simresults05.xlsx")

# ---- group: Domain box
data_31 = Data(["27.92759", "27.92695", "27.92952", "27.93361", "27.94205", "27.95578"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])
data_32 = Data(["31.124691", "31.124691", "31.094894", "31.070059", "31.055727", "31.049904"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])
temp_umcf_2pm_5 = Panel(data_31)
temp_envimet_2pm_7 = Panel(data_32)
data_33 = Data([0.008716202, 0.008716202, 0.008716136, 0.008716161, 0.00871627, 0.008716437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])
data_34 = Data(["Grasshopper.Kernel.Types.GH_ObjectWrapper", "Grasshopper.Kernel.Types.GH_ObjectWrapper", "Grasshopper.Kernel.Types.GH_ObjectWrapper", "Grasshopper.Kernel.Types.GH_ObjectWrapper", "Grasshopper.Kernel.Types.GH_ObjectWrapper", "Grasshopper.Kernel.Types.GH_ObjectWrapper"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])
humidity_envimet_2pm_9 = Panel(data_33)
humidity_umcf_2pm_3 = Panel(data_34)
data_35 = Data(["1.611027", "1.60438", "1.60242", "1.619539", "1.639639", "1.657475"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])
data_36 = Data([0.9777199211, 0.9630831456, 0.9658135987, 0.9784929425, 0.970825571, 0.9373934162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])
wind_envimet_2pm = Panel(data_35)
wind_umcf_2pm_3 = Panel(data_36)

# ---- group: At 1.7m height / Domain box
data_37 = Data(["32.033539", "32.033539", "32.010017", "31.99275", "31.984283", "31.982578"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])
data_38 = Data([27.9077, 27.9057, 27.90717, 27.90983, 27.91746, 27.93057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])
temp_umcf_2pm_6 = Panel(data_38)
temp_envimet_2pm_8 = Panel(data_37)
data_39 = Data(["Grasshopper.Kernel.Types.GH_ObjectWrapper", "Grasshopper.Kernel.Types.GH_ObjectWrapper", "Grasshopper.Kernel.Types.GH_ObjectWrapper", "Grasshopper.Kernel.Types.GH_ObjectWrapper", "Grasshopper.Kernel.Types.GH_ObjectWrapper", "Grasshopper.Kernel.Types.GH_ObjectWrapper"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])
data_40 = Data([0.008719331741, 0.008719331741, 0.008719189644, 0.008719190598, 0.008719305038, 0.008719490051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])
humidity_envimet_2pm_10 = Panel(data_40)
humidity_umcf_2pm_4 = Panel(data_39)
data_41 = Data([0.6499221229, 0.5946318171, 0.58957943, 0.6031161576, 0.6021544525, 0.5874446397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])
data_42 = Data(["1.160722", "1.190604", "1.245086", "1.292353", "1.324009", "1.346333"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])
wind_envimet_2pm_2 = Panel(data_42)
wind_umcf_2pm_4 = Panel(data_41)

# ---- group: At 1.7m height / Refinement box
data_43 = Data(["32.945404", "33.033157", "33.092346", "33.135612", "33.18655", "33.284687", "33.395702", "33.5116", "33.652454", "33.8419"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])
data_44 = Data(["27.52646", "27.51933", "27.45743", "27.46316", "27.42246", "27.44206", "27.4031", "27.41035", "27.41875", "27.32302"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])
temp_envimet_2pm_9 = Panel(data_43)
temp_umcf_2pm_7 = Panel(data_44)
data_45 = Data([0.008747909546, 0.008751400948, 0.008755482674, 0.008759583473, 0.008762364388, 0.008760994911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])
data_46 = Data(["Grasshopper.Kernel.Types.GH_ObjectWrapper", "Grasshopper.Kernel.Types.GH_ObjectWrapper", "Grasshopper.Kernel.Types.GH_ObjectWrapper", "Grasshopper.Kernel.Types.GH_ObjectWrapper", "Grasshopper.Kernel.Types.GH_ObjectWrapper", "Grasshopper.Kernel.Types.GH_ObjectWrapper"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])
humidity_umcf_2pm_5 = Panel(data_46)
humidity_envimet_2pm_11 = Panel(data_45)
data_47 = Data([0.5229268167, 0.5705976177, 0.6699296344, 0.6854302658, 0.7012924261, 0.7263139472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])
data_48 = Data([1.676413894, 1.715379238, 1.738255143, 1.738082051, 1.681066275, 1.574586511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])
wind_envimet_2pm_3 = Panel(data_48)
wind_umcf_2pm_5 = Panel(data_47)

# ----
xl_out = WriteToExcelClassic(WorkbookFilepath=path_5, Data=nullrep.Items, LocationAddress="A1", Clear=0, Stream=Toggle(True))
panel_17 = Panel("""T_ENVImet_HumanHeight_RefinementBox
T_UMCF_HumanHeight_RefinementBox
w_ENVImet_HumanHeight_RefinementBox
w_UMCF_HumanHeight_RefinementBox
U_ENVImet_HumanHeight_RefinementBox
U_UMCF_HumanHeight_RefinementBox
T_ENVImet_HumanHeight_DomainBox
T_UMCF_HumanHeight_DomainBox
w_ENVImet_HumanHeight_DomainBox
w_UMCF_HumanHeight_DomainBox
U_ENVImet_HumanHeight_DomainBox
U_UMCF_HumanHeight_DomainBox
T_ENVImet_TreeMidPt_DomainBox
T_UMCF_TreeMidPt_DomainBox
w_ENVImet_TreeMidPt_DomainBox
w_UMCF_TreeMidPt_DomainBox
U_ENVImet_TreeMidPt_DomainBox
U_UMCF_TreeMidPt_DomainBox""")
entwine_3 = Entwine(
    Branch00=temp_envimet_2pm_9,
    Branch01=temp_umcf_2pm_7,
    Branch02=humidity_envimet_2pm_11,
    Branch03=humidity_umcf_2pm_5,
    Branch04=wind_envimet_2pm_3,
    Branch05=wind_umcf_2pm_5,
    Branch06=temp_envimet_2pm_8,
    Branch07=temp_umcf_2pm_6,
    Branch08=humidity_envimet_2pm_10,
    Branch09=humidity_umcf_2pm_4,
    Branch010=wind_envimet_2pm_2,
    Branch011=wind_umcf_2pm_4,
    Branch012=temp_umcf_2pm_5,
    Branch013=temp_envimet_2pm_7,
    Branch014=humidity_umcf_2pm_3,
    Branch015=humidity_envimet_2pm_9,
    Branch016=wind_umcf_2pm_3,
    Branch017=wind_envimet_2pm,
    FlattenInputs=True)  # -> simplify(Result)
graft_2 = GraftTree(Tree=panel_17, IncludeEmptyLists=True, IncludeNullItems=True)  # -> simplify(Tree)
merge_5 = Merge(Data1=graft_2, Data2=entwine_3)
flip_2 = FlipMatrix(Data=merge_5)
nullrep_2 = ReplaceNulls(Items=flip_2)  # -> Items, Count
path_6 = FilePath("C:\Users\makel\Documents\ARQ\GT\Spring 2025\Data\simulationresults01.xlsx")
xl_out_2 = WriteToExcelClassic(WorkbookFilepath=path_6, Data=nullrep_2.Items, LocationAddress="A1", Clear=0, Stream=Toggle(False))
